# Grasshopper definition Assignment2_Grasshopper baked.gh (Grasshopper 1.0.7)

number_slider = Slider(26, range=0..80)
number_slider_2 = Slider(3.2, range=0..80)
number_slider_3 = Slider(80, range=-2..100)
number = Number(-0.5)
multiplication = Multiplication(A=number_slider_2, B=number)
hex_x = Integer(Slider(1, range=0..10))
hex_y = Integer(Slider(1, range=0..10))
hexagonal = Hexagonal(Plane=PlaneXY(0, 0, 0), Size=Slider(50, range=0..60), ExtentX=hex_x, ExtentY=hex_y)  # -> Cells, Points
subtraction = Subtraction(A=number_slider_3, B=number_slider)
rectangle = Rectangle(Plane=PlaneXY(0, 0, 0), XSize=number_slider_2, YSize=number_slider, Radius=0)  # -> Rectangle, Length
vector_xyz = VectorXYZ(XComponent=multiplication, YComponent=subtraction, ZComponent=0)  # -> Vector, Length
circle = Circle(Plane=PlaneXY(0, 0, 0), Radius=number_slider_3)
move = Move(Geometry=rectangle.Rectangle, Motion=vector_xyz.Vector)  # -> Geometry, Transform
polar_array = PolarArray(Geometry=move.Geometry, Plane=PlaneXY(0, 0, 0), Count=Slider(6, range=0..20), Angle=6.283185307)  # -> Geometry, Transform
region_difference = RegionDifference(CurvesA=hexagonal.Cells, CurvesB=polar_array.Geometry)
region_difference_2 = RegionDifference(CurvesA=circle, CurvesB=polar_array.Geometry)
